# Dynamo graph STING_FIXTURE_PLACEMENT.dyn (Dynamo 2.16.1.6226)
# STING Pack 11 — multi-objective fixture placement study.
# Wraps Core/Placement/FixturePlacementEngine as a Generative Design
# NSGA-II study. Consumes STING_PLACEMENT_RULES.json + family-type
# PLACE_HOST_TYPE_TXT / PLACE_MOUNT_HEIGHT_MM / PLACE_SPACING_RULE_TXT
# declarations. Optimises for three objectives:
#   1. Spacing variance (minimise) — consistent coverage
#   2. Coverage (maximise) — highest number of rooms with >= target density
#   3. Clearance violations (minimise) — count of STING_CLEARANCE_MM
#      infringements (directional Pack-2 params honoured)
# Study results (Pareto front) viewable in the Generative Design studio.

python = Python()  # unwired: spacingBias, coverageTarget, penalty
# ---------- python.python (36 lines) ----------
# STING Pack 11 — Generative Design bridge.
#
# Calls into StingTools.Core.Placement.FixturePlacementEngine via the
# CLR adapter. Generative Design evaluates this script N times across
# the input parameter ranges; we return the three objective scalars.
#
# The heavy lifting stays in C# — this file is only the GD harness.

import clr
try:
    clr.AddReferenceToFileAndPath(r'StingTools.dll')
    from StingTools.Core.Placement import FixturePlacementEngine
    from StingTools.Core.Placement import PlacementRuleLoader
except Exception as ex:
    # Generative Design sandbox sometimes loads the DLL from a different
    # directory — fall back to Current load context.
    from Autodesk.DesignScript.Runtime import IsVisibleInDynamoLibraryAttribute
    raise

# Inputs from the DYN Input nodes — wired by Generative Design.
spacingBias    = IN[0]
coverageTarget = IN[1]
penalty        = IN[2]

# Active Revit document is injected by Dynamo's RevitServices layer.
import RevitServices
from RevitServices.Persistence import DocumentManager
doc = DocumentManager.Instance.CurrentDBDocument

rules = PlacementRuleLoader.Load(doc.PathName)
result = FixturePlacementEngine.RunStudy(
    doc, rules, spacingBias, coverageTarget, penalty)

# Output: three objective scalars. Generative Design writes them into the
# Outputs declared at top of this .dyn file.
OUT = (result.SpacingVariance, result.CoveragePct, result.ClearanceViolations)
# ----------------------------------------
